# Grasshopper definition visual_debugger.gh (Grasshopper 1.0.8)

shapefile_path = Panel("..\input_data\AL_D194_11680_20250123.shp")
시경계 = Geometry(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)
block_generator = Python3Script(shapefile_path=shapefile_path)  # -> blocks; inputs shapefile_path: String
# ---------- block_generator: Python ----------
# r: pyshp, geopandas, networkx

import importlib
import shape_manager, block_generator
from block_generator import BlockGenerator
from shape_manager import ShapefileManager

# 모듈 새로고침
# importlib.reload(shape_manager)
# importlib.reload(block_generator)


shapefile_manager = ShapefileManager()
parcels = shapefile_manager.get_parcels_from_shapes(str(shapefile_path))

block_generator = BlockGenerator()
blocks = block_generator.generate(parcels)

print(f"Loaded {len(parcels)} parcels.")
# ---------- end block_generator ----------
save_path = Panel("..\output_data\")
evaluator = Python3Script(blocks=block_generator)  # -> blocks; inputs blocks: list
# ---------- evaluator: Python ----------
# r: pyshp, geopandas, networkx

import importlib
import shape_manager, block_generator, parcel_evaluator
from shape_manager import ShapefileManager

# 모듈 새로고침
# importlib.reload(shape_manager)
# importlib.reload(block_generator)


blocks = parcel_evaluator.evaluate(blocks)

shapefile_manager = ShapefileManager()
shapefile_manager.save_blocks_to_shapefile(blocks, save_path)
# ---------- end evaluator ----------
py3 = Python3Script(blocks=evaluator, save_path=save_path)  # -> out, a; inputs blocks: list, save_path: String
# ---------- py3: Python ----------
# r: pyshp, geopandas, networkx

import importlib
import shape_manager
from shape_manager import ShapefileManager


shapefile_manager = ShapefileManager()
shapefile_manager.save_blocks_to_shapefile(blocks, save_path)
# ---------- end py3 ----------
